# Grasshopper definition S4-graph-walker-custom.gh (Grasshopper 1.0.8)

number_slider = Slider(3, range=0..10)
graphs_05_shorest_paths = FilePath("C:\Users\david\Desktop\MPDA\repos\MPDA25-Session04\graphs\graphs-05-walker-custom.py")
make_sure_is_the_right_path = Panel(graphs_05_shorest_paths)
quadmesh = Mesh(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)
trimesh = Mesh(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)
mplane = MeshPlane(
    Boundary={Plane=PlaneXY(0, 0, 0), Size=Domain2(u=-10..10, v=-10..10)},
    WidthCount=number_slider,
    HeightCount=number_slider)  # -> Mesh, Area
restart = Button()
input_mesh = Mesh(trimesh)
file = ReadFile(File=graphs_05_shorest_paths, PerLineParse=False)
py3 = Python3Script(restart=restart, m=input_mesh)  # -> out, a; inputs restart: Boolean, m: Mesh
# ---------- py3: Python ----------
import scriptcontext as sc

if restart:
    sc.sticky["mesh"] = m
a = m
# ---------- end py3 ----------
py3_2 = Python3Script()  # -> out, a
# ---------- py3_2: Python ----------
import scriptcontext as sc

a =  sc.sticky["mesh"]
# ---------- end py3_2 ----------
input_mesh_2 = Mesh(py3_2.a)
py3_3 = Python3Script(script=file, m=input_mesh_2, s=Slider(0, range=0..10))  # -> out, a, b, c, d; inputs m: Mesh, s: Int32; unedited script template
all_shortest_paths = Data(py3_3.c)

# ---- group: custom logic
lng = ListLength(List=all_shortest_paths)
tstat = TreeStatistics(Tree=all_shortest_paths)  # -> Paths, Length, Count
sort = SortList(Keys=flatten(lng), ValuesA=tstat.Paths)  # -> reverse(Keys), reverse(ValuesA)
item = ListItem(List=sort.ValuesA, Index=0, Wrap=True)
branch = TreeBranch(Tree=all_shortest_paths, Path=item, MaintainPaths=True)

# ----
chosen_path = Data(branch)
demesh = DeconstructMesh(Mesh=input_mesh_2)  # -> Vertices, Faces, Colours, Normals
demesh_2 = DeconstructMesh(Mesh=input_mesh_2)  # -> Vertices, Faces, Colours, Normals
conmesh = ConstructMesh(Vertices=demesh_2.Vertices, Faces=graft(demesh_2.Faces))  # -> flatten(Mesh)
cull_i = CullIndex(List=demesh.Faces, Indices=chosen_path, Wrap=True)
conmesh_2 = ConstructMesh(Vertices=demesh.Vertices, Faces=graft(cull_i))  # -> flatten(Mesh)
item_2 = ListItem(List=conmesh, Index=chosen_path, Wrap=True)
clean = CombineClean(Meshes=conmesh_2)
py3_4 = Python3Script(m=clean)  # -> out, a; inputs m: Mesh
# ---------- py3_4: Python ----------
import scriptcontext as sc


sc.sticky["mesh"] = m
# ---------- end py3_4 ----------
preview = CustomPreview(Geometry=clean, Material=ColourSwatch(SwatchColor=RGBA(156, 156, 156, 109)))
